# Grasshopper definition Phone Stand.gh (Grasshopper 1.0.8)

phone_edge = Slider(2, range=0..200)
phone_viewing_angle = Slider(0, range=0..90)
offset = Slider(20, range=0..30)
phone_stand_length = Slider(92, range=0..200)
phone_stand_width = Slider(98, range=0..200)
phone_stand_height = Slider(15, range=0..200)
phone_stand_edge = Slider(10, range=0..10)
phone_width = Slider(79, range=0..200)
phone_height = Slider(162, range=0..200)
phone_thickness = Slider(8, range=0..200)
move_phone_back_and_forth = Slider(35, range=0..200)
offset_2 = Slider(13, range=0..30)
pi = Slider(3.141592, range=3.141592..4)
_180 = Slider(180, range=179..180)
yz_plane = YZPlane(Origin=Point(0, 0, 0))
xy_plane = XYPlane(Origin=Point(0, 0, 0))
yz_plane_2 = YZPlane(Origin=Point(0, 0, 0))
yz_plane_3 = YZPlane(Origin=Point(0, 0, 0))
yz_plane_4 = YZPlane(Origin=Point(0, 0, 0))
division = Division(A=pi, B=_180)
division_2 = Division(A=pi, B=_180)
division_3 = Division(A=pi, B=_180)
division_4 = Division(A=pi, B=_180)
_2 = Slider(2, range=2..3)
unit_z = UnitZ(Factor=phone_stand_height)
unit_x = UnitX(Factor=phone_thickness)
rectangle = Rectangle(Plane=yz_plane, XSize=phone_width, YSize=phone_height, Radius=phone_edge)  # -> Rectangle, Length
rectangle_2 = Rectangle(Plane=xy_plane, XSize=phone_stand_length, YSize=phone_stand_width, Radius=phone_stand_edge)  # -> Rectangle, Length
subtraction = Subtraction(A=phone_stand_width, B=phone_width)
rectangle_3 = Rectangle(Plane=yz_plane_2, XSize=phone_width, YSize=phone_height, Radius=phone_edge)  # -> Rectangle, Length
unit_x_2 = UnitX(Factor=phone_thickness)
unit_x_3 = UnitX(Factor=phone_thickness)
rectangle_4 = Rectangle(Plane=yz_plane_3, XSize=phone_width, YSize=phone_height, Radius=phone_edge)  # -> Rectangle, Length
unit_x_4 = UnitX(Factor=phone_thickness)
rectangle_5 = Rectangle(Plane=yz_plane_4, XSize=phone_width, YSize=phone_height, Radius=phone_edge)  # -> Rectangle, Length
multiplication = Multiplication(A=phone_viewing_angle, B=division)
addition = Addition(A=phone_viewing_angle, B=offset)
multiplication_2 = Multiplication(A=addition, B=division_2)
brep = Brep(rectangle_2.Rectangle)
brep_2 = Brep(rectangle.Rectangle)
brep_3 = Brep(rectangle_3.Rectangle)
division_5 = Division(A=subtraction, B=_2)
brep_4 = Brep(rectangle_4.Rectangle)
brep_5 = Brep(rectangle_5.Rectangle)
extrude = Extrude(Base=brep, Direction=unit_z)
addition_2 = Addition(A=move_phone_back_and_forth, B=offset_2)
extrude_2 = Extrude(Base=brep_2, Direction=unit_x)
extrude_3 = Extrude(Base=brep_3, Direction=unit_x_2)
xz_plane = XZPlane(Origin=Point(0, 0, 0))
xz_plane_2 = XZPlane(Origin=Point(0, 0, 0))
extrude_4 = Extrude(Base=brep_4, Direction=unit_x_3)
extrude_5 = Extrude(Base=brep_5, Direction=unit_x_4)
addition_3 = Addition(A=addition, B=offset)
multiplication_3 = Multiplication(A=addition_3, B=division_3)
unit_x_5 = UnitX(Factor=move_phone_back_and_forth)
unit_x_6 = UnitX(Factor=addition_2)
xz_plane_3 = XZPlane(Origin=Point(0, 0, 0))
xz_plane_4 = XZPlane(Origin=Point(0, 0, 0))
addition_4 = Addition(A=addition_2, B=offset_2)
unit_x_7 = UnitX(Factor=addition_4)
rotate = Rotate(Geometry=extrude_2, Angle=multiplication, Plane=xz_plane)  # -> Geometry, Transform
rotate_2 = Rotate(Geometry=extrude_3, Angle=multiplication_2, Plane=xz_plane_2)  # -> Geometry, Transform
addition_5 = Addition(A=addition_4, B=offset_2)
unit_x_8 = UnitX(Factor=addition_5)
addition_6 = Addition(A=addition_3, B=offset)
multiplication_4 = Multiplication(A=addition_6, B=division_4)
rotate_3 = Rotate(Geometry=extrude_4, Angle=multiplication_4, Plane=xz_plane_3)  # -> Geometry, Transform
rotate_4 = Rotate(Geometry=extrude_5, Angle=multiplication_3, Plane=xz_plane_4)  # -> Geometry, Transform
move = Move(Geometry=rotate.Geometry, Motion=unit_x_8)  # -> Geometry, Transform
move_2 = Move(Geometry=rotate_2.Geometry, Motion=unit_x_7)  # -> Geometry, Transform
unit_y = UnitY(Factor=division_5)
unit_y_2 = UnitY(Factor=division_5)
move_3 = Move(Geometry=rotate_3.Geometry, Motion=unit_x_5)  # -> Geometry, Transform
move_4 = Move(Geometry=rotate_4.Geometry, Motion=unit_x_6)  # -> Geometry, Transform
unit_y_3 = UnitY(Factor=division_5)
unit_y_4 = UnitY(Factor=division_5)
move_5 = Move(Geometry=move.Geometry, Motion=unit_y)  # -> Geometry, Transform
solid_difference = SolidDifference(BrepsA=extrude, BrepsB=move_5.Geometry)
move_6 = Move(Geometry=move_4.Geometry, Motion=unit_y_4)  # -> Geometry, Transform
move_7 = Move(Geometry=move_2.Geometry, Motion=unit_y_2)  # -> Geometry, Transform
move_8 = Move(Geometry=move_3.Geometry, Motion=unit_y_3)  # -> Geometry, Transform
solid_difference_2 = SolidDifference(BrepsA=solid_difference, BrepsB=move_7.Geometry)
solid_difference_3 = SolidDifference(BrepsA=solid_difference_2, BrepsB=move_6.Geometry)
solid_difference_4 = SolidDifference(BrepsA=solid_difference_3, BrepsB=move_8.Geometry)
custom_preview = CustomPreview(Geometry=solid_difference_4, Material=ColourSwatch(SwatchColor=RGB(138, 138, 138)))
